# Dynamo graph Create Sprinkler Heads From CAD2.dyn (Dynamo 3.3.0.6316)
# packages: Genius Loci 2024.5.29, Rhythm 2024.10.1

file_path = Filename(".\CAD Sprinkler Head.dwg")
import_dwg = Custom[Import DWG](Filepaths=file_path)  # package Genius Loci; Import DWGs in views with options. Use with the Enumerate DWG import options node. Based on an archilab's script.
geometry = Element.Geometry(element=import_dwg.ImportInstance)
byPatch = Surface.ByPatch(closedCurve=geometry)
code_block = CodeBlock { 0.001; }
thicken = Surface.Thicken(surface=byPatch, thickness=code_block)
byUnion = Solid.ByUnion(solids=thicken)
code_block_2 = CodeBlock { "Sprinkler Head"; }
categories = Categories("OST_GenericModel")
file_path_2 = Filename("..\..\..\ProgramData\Autodesk\RVT 2025\Family Templates\English-Imperial\Generic Model.rft")
code_block_3 = CodeBlock { "Default"; }
byName = Material.ByName(name=code_block_3)
ʳʰʸᵗʰᵐ_familyinstances = Rhythm.Revit.Elements.FamilyInstances.ByGeometry(solidGeometry=byUnion, name=code_block_2, category=categories, templatePath=file_path_2, material=byName)
